# Grasshopper definition simple_aggregation_decomposed.gh (Grasshopper 1.0.7)

# ----
# Module Dimensions
amount_of_tips = Slider(4, range=0..10)
length_long = Slider(500, range=0..1000)
tip_height = Slider(45, range=0..100)
length_short = Slider(200, range=0..1000)
width = Slider(300, range=0..1000)
center_box_height = Slider(10, range=0..10)

# ----
# Gaps for Simulation
gap_tip_tip = Slider(4, range=0..10)
gap_tip_sink = Slider(2, range=0..100)
gap_module_module_x_direction = Slider(6, range=0..100)
gap_module_module_y_direction = Slider(0, range=0..100)

# ----
# Wasp Settings
connecting_points_per_row = Slider(2, range=0..10)

# ---- group: Center Box Pybullet
center_box_height_2 = Number(center_box_height)
width_2 = Number(width)
gap_tip_sink_2 = Number(gap_tip_sink)
length = Number(length_short)
subtraction = Subtraction(A=center_box_height_2, B=gap_tip_sink_2)
box = CenterBox(Base=PlaneXY(0, 0, 0), X=expr("x/2", width_2), Y=expr("x/2", length), Z=expr("x/2", subtraction))

center_box_height_3 = Number(center_box_height)
gap_tip_sink_3 = Number(gap_tip_sink)
width_3 = Number(width)
length_2 = Number(length_long)
subtraction_2 = Subtraction(A=center_box_height_3, B=gap_tip_sink_3)
box_2 = CenterBox(Base=PlaneXY(0, 0, 0), X=expr("x/2", width_3), Y=expr("x/2", length_2), Z=expr("x/2", subtraction_2))

# ---- group: Center Box
width_4 = Number(width)
center_box_height_4 = Number(center_box_height)
length_3 = Number(length_short)
box_3 = CenterBox(Base=PlaneXY(0, 0, 0), X=expr("x/2", width_4), Y=expr("x/2", length_3), Z=expr("x/2", center_box_height_4))
debrep = DeconstructBrep(Brep=box_3)  # -> Faces, Edges, Vertices

# ---- group: Tips Above Wasp
tip_height_2 = Number(tip_height)
faces_center_box = Surface(debrep.Faces)
amount_of_tips_2 = Number(amount_of_tips)
length_4 = Number(length_short)
item = ListItem(List=faces_center_box, Index=Slider(5, range=0..10), Wrap=True)
divide = DivideDomain²(Domain=item, UCount=amount_of_tips_2, VCount=1)
division = Division(A=tip_height_2, B=2)
subsrf = Isotrim(Surface=item, Domain=divide)
dim = Dimensions(Surface=subsrf)  # -> UDimension, VDimension
area = Area(Geometry=subsrf)  # -> Area, Centroid
Z = UnitZ(Factor=division)
division_2 = Division(A=dim.UDimension, B=2)
move = Move(Geometry=area.Centroid, Motion=Z)  # -> Geometry, Transform
item_2 = ListItem(List=division_2, Index=0, Wrap=True)
box_4 = CenterBox(Base=move.Geometry, X=expr("x/2", item_2), Y=expr("x/2", length_4), Z=division)

# ----
faces_center_box_2 = Surface(debrep.Faces)

# ---- group: Tips Under Wasp
tip_height_3 = Number(tip_height)
length_5 = Number(length_short)
amount_of_tips_3 = Number(amount_of_tips)
division_3 = Division(A=tip_height_3, B=2)
item_3 = ListItem(List=faces_center_box_2, Index=Slider(4, range=0..10), Wrap=True)
divide_2 = DivideDomain²(Domain=item_3, UCount=1, VCount=amount_of_tips_3)
subsrf_2 = Isotrim(Surface=item_3, Domain=divide_2)
area_2 = Area(Geometry=subsrf_2)  # -> Area, Centroid
dim_2 = Dimensions(Surface=subsrf_2)  # -> UDimension, VDimension
division_4 = Division(A=dim_2.VDimension, B=2)
item_4 = ListItem(List=division_4, Index=0, Wrap=True)
neg = Negative(Value=division_3)
neg_2 = Negative(Value=item_4)
vec = VectorXYZ(XComponent=neg_2, YComponent=0, ZComponent=neg)  # -> Vector, Length
move_2 = Move(Geometry=area_2.Centroid, Motion=vec.Vector)  # -> Geometry, Transform
shift = ShiftList(List=move_2.Geometry, Shift=1, Wrap=Toggle(False))
box_5 = CenterBox(Base=shift, X=expr("x/2", item_4), Y=expr("x/2", length_5), Z=division_3)
tip_width = Number(item_4)

# ---- group: Tips Above Pybullet
faces_center_box_wasp = Surface(debrep.Faces)
amount_of_tips_4 = Number(amount_of_tips)
length_6 = Number(length_short)
tip_height_4 = Number(tip_height)
gap_tip_tip_2 = Number(gap_tip_tip)
division_5 = Division(A=tip_height_4, B=2)
item_5 = ListItem(List=faces_center_box_wasp, Index=Slider(5, range=0..10), Wrap=True)
divide_3 = DivideDomain²(Domain=item_5, UCount=amount_of_tips_4, VCount=1)
Z_2 = UnitZ(Factor=division_5)
subsrf_3 = Isotrim(Surface=item_5, Domain=divide_3)
dim_3 = Dimensions(Surface=subsrf_3)  # -> UDimension, VDimension
area_3 = Area(Geometry=subsrf_3)  # -> Area, Centroid
division_6 = Division(A=dim_3.UDimension, B=2)
move_3 = Move(Geometry=area_3.Centroid, Motion=Z_2)  # -> Geometry, Transform
item_6 = ListItem(List=division_6, Index=0, Wrap=True)
subtraction_3 = Subtraction(A=item_6, B=gap_tip_tip_2)
box_6 = CenterBox(Base=move_3.Geometry, X=expr("x/2", subtraction_3), Y=expr("x/2", length_6), Z=division_5)

# ---- group: Tips Under Pybullet
faces_center_box_wasp_2 = Surface(debrep.Faces)
amount_of_tips_5 = Number(amount_of_tips)
length_7 = Number(length_short)
tip_height_5 = Number(tip_height)
gap_tip_tip_3 = Number(gap_tip_tip)
division_7 = Division(A=tip_height_5, B=2)
item_7 = ListItem(List=faces_center_box_wasp_2, Index=Slider(4, range=0..10), Wrap=True)
divide_4 = DivideDomain²(Domain=item_7, UCount=1, VCount=amount_of_tips_5)
subsrf_4 = Isotrim(Surface=item_7, Domain=divide_4)
dim_4 = Dimensions(Surface=subsrf_4)  # -> UDimension, VDimension
area_4 = Area(Geometry=subsrf_4)  # -> Area, Centroid
division_8 = Division(A=dim_4.VDimension, B=2)
item_8 = ListItem(List=division_8, Index=0, Wrap=True)
neg_3 = Negative(Value=item_8)
neg_4 = Negative(Value=division_7)
vec_2 = VectorXYZ(XComponent=neg_3, YComponent=0, ZComponent=neg_4)  # -> Vector, Length
move_4 = Move(Geometry=area_4.Centroid, Motion=vec_2.Vector)  # -> Geometry, Transform
subtraction_4 = Subtraction(A=item_8, B=gap_tip_tip_3)
shift_2 = ShiftList(List=move_4.Geometry, Shift=1, Wrap=Toggle(False))
box_7 = CenterBox(Base=shift_2, X=expr("x/2", subtraction_4), Y=expr("x/2", length_7), Z=division_7)
tip_width_2 = Number(item_8)

# ---- group: Right half tip Pybullet
tip_width_3 = Number(tip_width_2)
vertices_center_box = Point(debrep.Vertices)
tip_height_6 = Number(tip_height)
length_8 = Number(length_short)
gap_tip_tip_4 = Number(gap_tip_tip)
subtraction_5 = Subtraction(A=tip_width_3, B=gap_tip_tip_4)
division_9 = Division(A=subtraction_5, B=2)
neg_5 = Negative(Value=tip_height_6)
item_9 = ListItem(List=vertices_center_box, Index=Slider(1, range=0..1), Wrap=True)
neg_6 = Negative(Value=division_9)
box_8 = DomainBox(Base=item_9, X=neg_6, Y=length_8, Z=neg_5)

# ---- group: Left half tip Pybullet
vertices_center_box_2 = Point(debrep.Vertices)
tip_height_7 = Number(tip_height)
tip_width_4 = Number(tip_width_2)
length_9 = Number(length_short)
gap_tip_tip_5 = Number(gap_tip_tip)
subtraction_6 = Subtraction(A=tip_width_4, B=gap_tip_tip_5)
item_10 = ListItem(List=vertices_center_box_2, Index=0, Wrap=True)
division_10 = Division(A=subtraction_6, B=2)
neg_7 = Negative(Value=tip_height_7)
box_9 = DomainBox(Base=item_10, X=division_10, Y=length_9, Z=neg_7)

# ---- group: Right half tip Wasp
length_10 = Number(length_short)
tip_width_5 = Number(tip_width)
tip_height_8 = Number(tip_height)
vertices_center_box_3 = Point(debrep.Vertices)
division_11 = Division(A=tip_width_5, B=2)
neg_8 = Negative(Value=tip_height_8)
item_11 = ListItem(List=vertices_center_box_3, Index=Slider(1, range=0..1), Wrap=True)
neg_9 = Negative(Value=division_11)
box_10 = DomainBox(Base=item_11, X=neg_9, Y=length_10, Z=neg_8)

# ---- group: Left half tip Wasp
vertices_center_box_4 = Point(debrep.Vertices)
tip_width_6 = Number(tip_width)
length_11 = Number(length_short)
tip_height_9 = Number(tip_height)
item_12 = ListItem(List=vertices_center_box_4, Index=0, Wrap=True)
division_12 = Division(A=tip_width_6, B=2)
neg_10 = Negative(Value=tip_height_9)
box_11 = DomainBox(Base=item_12, X=division_12, Y=length_11, Z=neg_10)

# ---- group: Center Box
center_box_height_5 = Number(center_box_height)
width_5 = Number(width)
length_12 = Number(length_long)
box_12 = CenterBox(Base=PlaneXY(0, 0, 0), X=expr("x/2", width_5), Y=expr("x/2", length_12), Z=expr("x/2", center_box_height_5))
debrep_2 = DeconstructBrep(Brep=box_12)  # -> Faces, Edges, Vertices

# ---- group: Tips Above Wasp
tip_height_10 = Number(tip_height)
faces_center_box_3 = Surface(debrep_2.Faces)
amount_of_tips_6 = Number(amount_of_tips)
length_13 = Number(length_long)
item_13 = ListItem(List=faces_center_box_3, Index=Slider(5, range=0..10), Wrap=True)
divide_5 = DivideDomain²(Domain=item_13, UCount=amount_of_tips_6, VCount=1)
division_13 = Division(A=tip_height_10, B=2)
subsrf_5 = Isotrim(Surface=item_13, Domain=divide_5)
dim_5 = Dimensions(Surface=subsrf_5)  # -> UDimension, VDimension
area_5 = Area(Geometry=subsrf_5)  # -> Area, Centroid
Z_3 = UnitZ(Factor=division_13)
division_14 = Division(A=dim_5.UDimension, B=2)
move_5 = Move(Geometry=area_5.Centroid, Motion=Z_3)  # -> Geometry, Transform
item_14 = ListItem(List=division_14, Index=0, Wrap=True)
box_13 = CenterBox(Base=move_5.Geometry, X=expr("x/2", item_14), Y=expr("x/2", length_13), Z=division_13)

# ----
faces_center_box_4 = Surface(debrep_2.Faces)

# ---- group: Tips Under Wasp
tip_height_11 = Number(tip_height)
length_14 = Number(length_long)
amount_of_tips_7 = Number(amount_of_tips)
division_15 = Division(A=tip_height_11, B=2)
item_15 = ListItem(List=faces_center_box_4, Index=Slider(4, range=0..10), Wrap=True)
divide_6 = DivideDomain²(Domain=item_15, UCount=1, VCount=amount_of_tips_7)
subsrf_6 = Isotrim(Surface=item_15, Domain=divide_6)
area_6 = Area(Geometry=subsrf_6)  # -> Area, Centroid
dim_6 = Dimensions(Surface=subsrf_6)  # -> UDimension, VDimension
division_16 = Division(A=dim_6.VDimension, B=2)
item_16 = ListItem(List=division_16, Index=0, Wrap=True)
neg_11 = Negative(Value=division_15)
neg_12 = Negative(Value=item_16)
vec_3 = VectorXYZ(XComponent=neg_12, YComponent=0, ZComponent=neg_11)  # -> Vector, Length
move_6 = Move(Geometry=area_6.Centroid, Motion=vec_3.Vector)  # -> Geometry, Transform
shift_3 = ShiftList(List=move_6.Geometry, Shift=1, Wrap=Toggle(False))
box_14 = CenterBox(Base=shift_3, X=expr("x/2", item_16), Y=expr("x/2", length_14), Z=division_15)
tip_width_7 = Number(item_16)

# ---- group: Tips Above Pybullet
faces_center_box_wasp_3 = Surface(debrep_2.Faces)
amount_of_tips_8 = Number(amount_of_tips)
length_15 = Number(length_long)
tip_height_12 = Number(tip_height)
gap_tip_tip_6 = Number(gap_tip_tip)
division_17 = Division(A=tip_height_12, B=2)
item_17 = ListItem(List=faces_center_box_wasp_3, Index=Slider(5, range=0..10), Wrap=True)
divide_7 = DivideDomain²(Domain=item_17, UCount=amount_of_tips_8, VCount=1)
Z_4 = UnitZ(Factor=division_17)
subsrf_7 = Isotrim(Surface=item_17, Domain=divide_7)
dim_7 = Dimensions(Surface=subsrf_7)  # -> UDimension, VDimension
area_7 = Area(Geometry=subsrf_7)  # -> Area, Centroid
division_18 = Division(A=dim_7.UDimension, B=2)
move_7 = Move(Geometry=area_7.Centroid, Motion=Z_4)  # -> Geometry, Transform
item_18 = ListItem(List=division_18, Index=0, Wrap=True)
subtraction_7 = Subtraction(A=item_18, B=gap_tip_tip_6)
box_15 = CenterBox(Base=move_7.Geometry, X=expr("x/2", subtraction_7), Y=expr("x/2", length_15), Z=division_17)

# ---- group: Tips Under Pybullet
faces_center_box_wasp_4 = Surface(debrep_2.Faces)
amount_of_tips_9 = Number(amount_of_tips)
length_16 = Number(length_long)
tip_height_13 = Number(tip_height)
gap_tip_tip_7 = Number(gap_tip_tip)
division_19 = Division(A=tip_height_13, B=2)
item_19 = ListItem(List=faces_center_box_wasp_4, Index=Slider(4, range=0..10), Wrap=True)
divide_8 = DivideDomain²(Domain=item_19, UCount=1, VCount=amount_of_tips_9)
subsrf_8 = Isotrim(Surface=item_19, Domain=divide_8)
dim_8 = Dimensions(Surface=subsrf_8)  # -> UDimension, VDimension
area_8 = Area(Geometry=subsrf_8)  # -> Area, Centroid
division_20 = Division(A=dim_8.VDimension, B=2)
item_20 = ListItem(List=division_20, Index=0, Wrap=True)
neg_13 = Negative(Value=item_20)
neg_14 = Negative(Value=division_19)
vec_4 = VectorXYZ(XComponent=neg_13, YComponent=0, ZComponent=neg_14)  # -> Vector, Length
move_8 = Move(Geometry=area_8.Centroid, Motion=vec_4.Vector)  # -> Geometry, Transform
subtraction_8 = Subtraction(A=item_20, B=gap_tip_tip_7)
shift_4 = ShiftList(List=move_8.Geometry, Shift=1, Wrap=Toggle(False))
box_16 = CenterBox(Base=shift_4, X=expr("x/2", subtraction_8), Y=expr("x/2", length_16), Z=division_19)
tip_width_8 = Number(item_20)

# ---- group: Right half tip Pybullet
tip_width_9 = Number(tip_width_8)
vertices_center_box_5 = Point(debrep_2.Vertices)
tip_height_14 = Number(tip_height)
length_17 = Number(length_long)
gap_tip_tip_8 = Number(gap_tip_tip)
subtraction_9 = Subtraction(A=tip_width_9, B=gap_tip_tip_8)
division_21 = Division(A=subtraction_9, B=2)
neg_15 = Negative(Value=tip_height_14)
item_21 = ListItem(List=vertices_center_box_5, Index=Slider(1, range=0..1), Wrap=True)
neg_16 = Negative(Value=division_21)
box_17 = DomainBox(Base=item_21, X=neg_16, Y=length_17, Z=neg_15)

# ---- group: Left half tip Pybullet
vertices_center_box_6 = Point(debrep_2.Vertices)
tip_height_15 = Number(tip_height)
tip_width_10 = Number(tip_width_8)
length_18 = Number(length_long)
gap_tip_tip_9 = Number(gap_tip_tip)
subtraction_10 = Subtraction(A=tip_width_10, B=gap_tip_tip_9)
item_22 = ListItem(List=vertices_center_box_6, Index=0, Wrap=True)
division_22 = Division(A=subtraction_10, B=2)
neg_17 = Negative(Value=tip_height_15)
box_18 = DomainBox(Base=item_22, X=division_22, Y=length_18, Z=neg_17)

# ---- group: Right half tip Wasp
length_19 = Number(length_long)
tip_width_11 = Number(tip_width_7)
tip_height_16 = Number(tip_height)
vertices_center_box_7 = Point(debrep_2.Vertices)
division_23 = Division(A=tip_width_11, B=2)
neg_18 = Negative(Value=tip_height_16)
item_23 = ListItem(List=vertices_center_box_7, Index=Slider(1, range=0..1), Wrap=True)
neg_19 = Negative(Value=division_23)
box_19 = DomainBox(Base=item_23, X=neg_19, Y=length_19, Z=neg_18)

# ---- group: Left half tip Wasp
vertices_center_box_8 = Point(debrep_2.Vertices)
tip_width_12 = Number(tip_width_7)
length_20 = Number(length_long)
tip_height_17 = Number(tip_height)
item_24 = ListItem(List=vertices_center_box_8, Index=0, Wrap=True)
division_24 = Division(A=tip_width_12, B=2)
neg_20 = Negative(Value=tip_height_17)
box_20 = DomainBox(Base=item_24, X=division_24, Y=length_20, Z=neg_20)

# ---- group: Wasp Part
half_tip_right = Box(box_10)
center_box = Box(box_3)
tips_above = Box(box_4)
tips_under = Box(box_5)
half_tip_left = Box(box_11)
merge = Merge(Data1=tips_above, Data2=center_box, Data3=tips_under, Data4=half_tip_right, Data5=half_tip_left)
sunion = SolidUnion(Breps=flatten(merge))

half_tip_right_2 = Box(box_19)
center_box_2 = Box(box_12)
tips_under_2 = Box(box_14)
tips_above_2 = Box(box_13)
half_tip_left_2 = Box(box_20)
merge_2 = Merge(Data1=tips_above_2, Data2=center_box_2, Data3=tips_under_2, Data4=half_tip_right_2, Data5=half_tip_left_2)
sunion_2 = SolidUnion(Breps=flatten(merge_2))

# ---- group: Pybullet Part Temp
tips_above_pybullet = Box(box_6)
center_box_pybullet = Box(box)
half_tip_right_3 = Box(box_8)
tips_under_pybullet = Box(box_7)
half_tip_left_3 = Box(box_9)
merge_3 = Merge(
    Data1=center_box_pybullet,
    Data2=tips_above_pybullet,
    Data3=tips_under_pybullet,
    Data4=half_tip_right_3,
    Data5=half_tip_left_3)  # -> flatten(Result)
module_pybullet_temp = Box(merge_3)

center_box_pybullet_2 = Box(box_2)
tips_above_pybullet_2 = Box(box_15)
half_tip_right_4 = Box(box_17)
tips_under_pybullet_2 = Box(box_16)
half_tip_left_4 = Box(box_18)
merge_4 = Merge(
    Data1=center_box_pybullet_2,
    Data2=tips_above_pybullet_2,
    Data3=tips_under_pybullet_2,
    Data4=half_tip_right_4,
    Data5=half_tip_left_4)  # -> flatten(Result)
module_pybullet_temp_2 = Box(merge_4)

# ----
# WASP SHORT PART
# GEOMETRY
module_wasp = Brep(sunion)
dam = DataDam(DataA=module_wasp, BufferDelay=10000000, BufferMode=0)

# ----
# WASP LONG PART
# GEOMETRY
module_wasp_2 = Brep(sunion_2)
dam_2 = DataDam(DataA=module_wasp_2, BufferDelay=10000000, BufferMode=0)

# ----
# PYBULLET PART SHORT
gap_module_module_y_direction_2 = Number(gap_module_module_y_direction)
module_wasp_3 = Brep(module_wasp)
gap_module_module_x_direction_2 = Number(gap_module_module_x_direction)
module_pybullet_temp_3 = Box(module_pybullet_temp)
gap_tip_sink_4 = Number(gap_tip_sink)
bbox = BoundingBox(Content=module_wasp_3, Plane=PlaneXY(0, 0, 0))  # -> Box, Box_2
area_9 = Area(Geometry=bbox.Box)  # -> Area, Centroid
debox = DeconstructBox(Box=bbox.Box_2)  # -> Plane, X, Y, Z
num = Number(debox.X)
num_2 = Number(debox.Y)
num_3 = Number(debox.Z)
subtraction_11 = Subtraction(A=num, B=gap_module_module_x_direction_2)
subtraction_12 = Subtraction(A=num_2, B=gap_module_module_y_direction_2)
subtraction_13 = Subtraction(A=num_3, B=gap_tip_sink_4)
box_21 = CenterBox(Base=area_9.Centroid, X=expr("x/2", subtraction_11), Y=expr("x/2", subtraction_12), Z=expr("x/2", subtraction_13))
sint = SolidIntersection(BrepsA=module_pybullet_temp_3, BrepsB=box_21)  # -> simplify(flatten(Result))

# ----
# PYBULLET PART SHORT
module_wasp_4 = Brep(module_wasp_2)
gap_module_module_y_direction_3 = Number(gap_module_module_y_direction)
module_pybullet_temp_4 = Box(module_pybullet_temp_2)
gap_module_module_x_direction_3 = Number(gap_module_module_x_direction)
gap_tip_sink_5 = Number(gap_tip_sink)
bbox_2 = BoundingBox(Content=module_wasp_4, Plane=PlaneXY(0, 0, 0))  # -> Box, Box_2
area_10 = Area(Geometry=bbox_2.Box)  # -> Area, Centroid
debox_2 = DeconstructBox(Box=bbox_2.Box_2)  # -> Plane, X, Y, Z
num_4 = Number(debox_2.X)
num_5 = Number(debox_2.Y)
num_6 = Number(debox_2.Z)
subtraction_14 = Subtraction(A=num_4, B=gap_module_module_x_direction_3)
subtraction_15 = Subtraction(A=num_5, B=gap_module_module_y_direction_3)
subtraction_16 = Subtraction(A=num_6, B=gap_tip_sink_5)
box_22 = CenterBox(Base=area_10.Centroid, X=expr("x/2", subtraction_14), Y=expr("x/2", subtraction_15), Z=expr("x/2", subtraction_16))
sint_2 = SolidIntersection(BrepsA=module_pybullet_temp_4, BrepsB=box_22)  # -> simplify(flatten(Result))

# ----
# PYBULLET SHORT PART
# DECOMPOSED GEOMETRY
module_pybullet = Box(sint)

# ----
# PYBULLET SHORT PART
# DECOMPOSED GEOMETRY
module_pybullet_2 = Box(sint_2)

module_wasp_5 = Brep(dam_2)
debrep_3 = DeconstructBrep(Brep=flatten(module_wasp_5))  # -> Faces, Edges, Vertices
module_faces = Surface(debrep_3.Faces)

module_wasp_6 = Brep(dam)
debrep_4 = DeconstructBrep(Brep=flatten(module_wasp_6))  # -> Faces, Edges, Vertices
module_faces_2 = Surface(debrep_4.Faces)

# ---- group: Connections Sink
connecting_points_per_row_2 = Number(connecting_points_per_row)
module_wasp_7 = Brep(module_wasp_5)
module_faces_3 = Surface(module_faces)
panel = Panel("""34
29
39
44""")
panel_2 = Panel("""4
9
14""")
item_25 = ListItem(List=flatten(module_faces_3), Index=panel, Wrap=True)
item_26 = ListItem(List=flatten(module_faces_3), Index=panel_2, Wrap=True)
divide_9 = DivideDomain²(Domain=item_25, UCount=1, VCount=connecting_points_per_row_2)
divide_10 = DivideDomain²(Domain=item_26, UCount=connecting_points_per_row_2, VCount=1)
subsrf_9 = Isotrim(Surface=graft(item_25), Domain=divide_9)
subsrf_10 = Isotrim(Surface=graft(item_26), Domain=divide_10)
area_11 = Area(Geometry=flatten([subsrf_9, subsrf_10]))  # -> Area, Centroid
Y = UnitY(Factor=1)
line = LineSDL(Start=area_11.Centroid, Direction=Y, Length=1)
conndir = Wasp_ConnectionFromDirection(GEO=module_wasp_7, CEN=area_11.Centroid, UP=line, T="TIP")  # -> CONN, PLN_OUT; inputs CEN: list of Point3d, UP: list of Curve, T: list; plug-in component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

# ---- group: Connections Tip
connecting_points_per_row_3 = Number(connecting_points_per_row)
module_faces_4 = Surface(module_faces)
module_wasp_8 = Brep(module_wasp_5)
tip_width_13 = Number(tip_width_2)
item_27 = ListItem(List=flatten(module_faces_4), Index="53", Wrap=True)
item_28 = ListItem(List=flatten(module_faces_4), Index="56", Wrap=True)
divide_11 = DivideDomain²(Domain=item_27, UCount=4, VCount=connecting_points_per_row_3)
divide_12 = DivideDomain²(Domain=item_28, UCount=connecting_points_per_row_3, VCount=4)
shift_5 = ShiftList(List=divide_11, Shift=connecting_points_per_row_3, Wrap=False)
subsrf_11 = Isotrim(Surface=graft(item_27), Domain=shift_5)
subsrf_12 = Isotrim(Surface=graft(item_28), Domain=divide_12)
neg_21 = Negative(Value=tip_width_13)
area_12 = Area(Geometry=subsrf_11)  # -> Area, Centroid
area_13 = Area(Geometry=subsrf_12)  # -> Area, Centroid
X = UnitX(Factor=neg_21)
move_9 = Move(Geometry=area_12.Centroid, Motion=X)  # -> Geometry, Transform
Y_2 = UnitY(Factor=1)
line_2 = LineSDL(Start=[move_9.Geometry, area_13.Centroid], Direction=Y_2, Length=1)
conndir_2 = Wasp_ConnectionFromDirection(GEO=module_wasp_8, CEN=[move_9.Geometry, area_13.Centroid], UP=line_2, T="SINK")  # -> CONN, PLN_OUT; inputs CEN: list of Point3d, UP: list of Curve, T: list; plug-in component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

# ---- group: Connections Side
module_wasp_9 = Brep(module_wasp_5)
module_faces_5 = Surface(module_faces)
panel_3 = Panel("""21
18""")
item_29 = ListItem(List=flatten(module_faces_5), Index=panel_3, Wrap=True)
area_14 = Area(Geometry=item_29)  # -> Area, Centroid
Z_5 = UnitZ(Factor=1)
line_3 = LineSDL(Start=area_14.Centroid, Direction=Z_5, Length=1)
conndir_3 = Wasp_ConnectionFromDirection(GEO=module_wasp_9, CEN=area_14.Centroid, UP=line_3, T="SIDE")  # -> CONN, PLN_OUT; inputs CEN: list of Point3d, UP: list of Curve, T: list; plug-in component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

# ---- group: Connections Front
module_wasp_10 = Brep(module_wasp_5)
bbox_3 = BoundingBox(Content=module_wasp_10, Plane=PlaneXY(0, 0, 0))  # -> Box, Box_2
debrep_5 = DeconstructBrep(Brep=bbox_3.Box)  # -> Faces, Edges, Vertices
area_15 = Area(Geometry=debrep_5.Faces)  # -> Area, Centroid
panel_4 = Panel("""0
2""")
item_30 = ListItem(List=area_15.Centroid, Index=panel_4, Wrap=True)
Z_6 = UnitZ(Factor=1)
line_4 = LineSDL(Start=item_30, Direction=Z_6, Length=1)
conndir_4 = Wasp_ConnectionFromDirection(GEO=module_wasp_10, CEN=item_30, UP=line_4, T="FRONT")  # -> CONN, PLN_OUT; inputs CEN: list of Point3d, UP: list of Curve, T: list; plug-in component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

# ---- group: Connections Sink
connecting_points_per_row_4 = Number(connecting_points_per_row)
module_wasp_11 = Brep(module_wasp_6)
module_faces_6 = Surface(module_faces_2)
panel_5 = Panel("""34
29
39
44""")
panel_6 = Panel("""4
9
14""")
item_31 = ListItem(List=flatten(module_faces_6), Index=panel_5, Wrap=True)
item_32 = ListItem(List=flatten(module_faces_6), Index=panel_6, Wrap=True)
divide_13 = DivideDomain²(Domain=item_31, UCount=1, VCount=connecting_points_per_row_4)
divide_14 = DivideDomain²(Domain=item_32, UCount=connecting_points_per_row_4, VCount=1)
subsrf_13 = Isotrim(Surface=graft(item_31), Domain=divide_13)
subsrf_14 = Isotrim(Surface=graft(item_32), Domain=divide_14)
area_16 = Area(Geometry=flatten([subsrf_13, subsrf_14]))  # -> Area, Centroid
Y_3 = UnitY(Factor=1)
line_5 = LineSDL(Start=area_16.Centroid, Direction=Y_3, Length=1)
conndir_5 = Wasp_ConnectionFromDirection(GEO=module_wasp_11, CEN=area_16.Centroid, UP=line_5, T="TIP")  # -> CONN, PLN_OUT; inputs CEN: list of Point3d, UP: list of Curve, T: list; plug-in component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

# ---- group: Connections Tip
connecting_points_per_row_5 = Number(connecting_points_per_row)
module_faces_7 = Surface(module_faces_2)
module_wasp_12 = Brep(module_wasp_6)
tip_width_14 = Number(tip_width_2)
item_33 = ListItem(List=flatten(module_faces_7), Index="53", Wrap=True)
item_34 = ListItem(List=flatten(module_faces_7), Index="56", Wrap=True)
divide_15 = DivideDomain²(Domain=item_33, UCount=4, VCount=connecting_points_per_row_5)
divide_16 = DivideDomain²(Domain=item_34, UCount=connecting_points_per_row_5, VCount=4)
shift_6 = ShiftList(List=divide_15, Shift=connecting_points_per_row_5, Wrap=False)
subsrf_15 = Isotrim(Surface=graft(item_33), Domain=shift_6)
subsrf_16 = Isotrim(Surface=graft(item_34), Domain=divide_16)
neg_22 = Negative(Value=tip_width_14)
area_17 = Area(Geometry=subsrf_15)  # -> Area, Centroid
area_18 = Area(Geometry=subsrf_16)  # -> Area, Centroid
X_2 = UnitX(Factor=neg_22)
move_10 = Move(Geometry=area_17.Centroid, Motion=X_2)  # -> Geometry, Transform
Y_4 = UnitY(Factor=1)
line_6 = LineSDL(Start=[move_10.Geometry, area_18.Centroid], Direction=Y_4, Length=1)
conndir_6 = Wasp_ConnectionFromDirection(GEO=module_wasp_12, CEN=[move_10.Geometry, area_18.Centroid], UP=line_6, T="SINK")  # -> CONN, PLN_OUT; inputs CEN: list of Point3d, UP: list of Curve, T: list; plug-in component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

# ---- group: Connections Side
module_wasp_13 = Brep(module_wasp_6)
module_faces_8 = Surface(module_faces_2)
panel_7 = Panel("""21
18""")
item_35 = ListItem(List=flatten(module_faces_8), Index=panel_7, Wrap=True)
area_19 = Area(Geometry=item_35)  # -> Area, Centroid
Z_7 = UnitZ(Factor=1)
line_7 = LineSDL(Start=area_19.Centroid, Direction=Z_7, Length=1)
conndir_7 = Wasp_ConnectionFromDirection(GEO=module_wasp_13, CEN=area_19.Centroid, UP=line_7, T="SIDE")  # -> CONN, PLN_OUT; inputs CEN: list of Point3d, UP: list of Curve, T: list; plug-in component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

# ---- group: Connections Front
module_wasp_14 = Brep(module_wasp_6)
bbox_4 = BoundingBox(Content=module_wasp_14, Plane=PlaneXY(0, 0, 0))  # -> Box, Box_2
debrep_6 = DeconstructBrep(Brep=bbox_4.Box)  # -> Faces, Edges, Vertices
area_20 = Area(Geometry=debrep_6.Faces)  # -> Area, Centroid
panel_8 = Panel("""0
2""")
item_36 = ListItem(List=area_20.Centroid, Index=panel_8, Wrap=True)
Z_8 = UnitZ(Factor=1)
line_8 = LineSDL(Start=item_36, Direction=Z_8, Length=1)
conndir_8 = Wasp_ConnectionFromDirection(GEO=module_wasp_14, CEN=item_36, UP=line_8, T="FRONT")  # -> CONN, PLN_OUT; inputs CEN: list of Point3d, UP: list of Curve, T: list; plug-in component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

# ---- group: LONG MODULE WASP
module_wasp_15 = Brep(module_wasp_5)
panel_9 = Panel("long")
merge_5 = Merge(Data1=conndir_2.CONN, Data2=conndir.CONN, Data3=conndir_4.CONN, Data4=conndir_3.CONN)
part = Wasp_BasicPart(NAME=panel_9, GEO=module_wasp_15, CONN=flatten(merge_5))  # -> PART; inputs GEO: Mesh, CONN: list, COLL: Mesh, ATTR: list; plug-in component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

# ---- group: SHORT MODULE WASP
module_wasp_16 = Brep(module_wasp_6)
panel_10 = Panel("short")
merge_6 = Merge(Data1=conndir_6.CONN, Data2=conndir_5.CONN, Data3=conndir_8.CONN, Data4=conndir_7.CONN)
part_2 = Wasp_BasicPart(NAME=panel_10, GEO=module_wasp_16, CONN=flatten(merge_6))  # -> PART; inputs GEO: Mesh, CONN: list, COLL: Mesh, ATTR: list; plug-in component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

# ----
# Decomposed Meshes
path_mapper = PathMapper(module_pybullet, source="{A}", target="{A;0}")
path_mapper_2 = PathMapper(module_pybullet_2, source="{A}", target="{A;1}")
smesh = SimpleMesh(Brep=[path_mapper_2, path_mapper])

merge_7 = Merge(Data1=part_2, Data2=part)
merge_8 = Merge(Data1=panel_10, Data2=panel_9)

aggregation_rules = Panel("""TIP>SINK
SINK>TIP
FRONT>FRONT
SIDE>SIDE""")
rulegen = Wasp_RulesGenerator(PART=merge_7, GR=aggregation_rules)  # -> R; inputs PART: list, SELF_P: Boolean, SELF_C: Boolean, TYP: Boolean, GR: list; plug-in component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

part_count = Slider(100, range=0..1000)
reset_aggregation = Button()
stochasticaggregation = Wasp_StochasticAggregation(PART=flatten(merge_7), N=part_count, RULES=rulegen, RESET=reset_aggregation)  # -> AGGR, PART_OUT; inputs PART: list, PREV: list, N: Int32, RULES: list, MODE: Int32, GC: list, RESET: Boolean; plug-in component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

# ---- group: Sort Modules vom Bottom to Top
depart = Wasp_DeconstructPart(PART=stochasticaggregation.PART_OUT)  # -> NAME, ID, GEO, CONN, COLL, TR, PARENT, CHILD, ADD_COLL, ATTR; plug-in component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
volume = Volume(Geometry=depart.GEO)  # -> Volume, flatten(Centroid)
pdecon = Deconstruct(Point=volume.Centroid)  # -> XComponent, YComponent, ZComponent
sort = SortList(Keys=pdecon.ZComponent, ValuesA=stochasticaggregation.PART_OUT)  # -> Keys, ValuesA
split = SplitList(List=sort.ValuesA, Index=Slider(98, range=0..100))  # -> ListA, ListB

# ----
# Part Properties
# Properties preceded by "#" are ignored.
panel_11 = Panel("""mass_kg: 1.0
friction: 0.5""")
panel_12 = Panel("""mass_kg: 1.0
friction: 0.5""")
merge_9 = Merge(Data1=panel_11, Data2=panel_12)

# ----
# Saving a .json file with module information
panel_13 = Panel("Simple Aggregation")
path = FilePath("C:\Users\tim\Desktop\")
waspsave = Wasp_SaveToFile(AGGR=stochasticaggregation.AGGR, PATH=path, NAME=panel_13, SAVE=Button())  # -> TXT, FILE; plug-in component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

# ----
# Visualization
namefilter = Wasp_FilterPartsByName(PART=stochasticaggregation.PART_OUT, NAME=merge_8)  # -> PART_OUT, MASK; inputs PART: list, NAME: list; plug-in component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
partgeo = Wasp_GetPartGeometry(PART=namefilter.PART_OUT)  # -> GEO; plug-in component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
merge_10 = Merge(Data1=ColourSwatch(SwatchColor=RGB(158, 5, 5)), Data2=ColourSwatch(SwatchColor=RGB(61, 158, 5)))
preview = CustomPreview(Geometry=partgeo, Material=graft(merge_10))

# ----
# Export
geo = Geometry(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)
gap_module_module_x_direction_4 = Number(gap_module_module_x_direction)
division_25 = Division(A=gap_module_module_x_direction_4, B=2)
mesh = MeshBrep(
    Brep=geo,
    Settings={GridMaxCount=0, GridMinCount=16, JaggedSeams=False, MaxEdgeLength=0, MinEdgeLength=0.0001, MinTolerance=0, Refine=True, RefineAngle=0, RelativeTolerance=0.65, SimplePlanes=True, Tolerance=0})
export_data = Button()
python = GhPythonScript(
    run=export_data,
    parts=merge_7,
    part_properties=merge_9,
    rules=rulegen,
    decomposed_meshes=smesh,
    global_target_shape=mesh,
    output_path="C:\Users\tim\Desktop\parts",
    gap_size_mm=division_25)  # inputs parts: list, part_properties: list, rules: list, decomposed_meshes: tree
# ---------- python: Python ----------
__author__ = "tim"
__version__ = "2020.05.11"

import rhinoscriptsyntax as rs
import os

import math
import json

import Rhino

from System import Guid
import Rhino.Geometry as rg

def write_mesh(file, mesh, name):
    f = file
    if isinstance(mesh, Guid):
        mesh = rs.coercemesh(mesh)
    mesh.Faces.ConvertQuadsToTriangles();
    f.write("o {}\n".format(name))
    for v in mesh.Vertices:
        f.write("v {:0.8f} {:0.8f} {:0.8f}\n".format(v.X - c.X, v.Y - c.Y, v.Z - c.Z))
    for tc in mesh.TextureCoordinates:
        f.write("vt {:0.8f} {:0.8f}\n".format(tc.X, tc.Y))
    for n in mesh.Normals:
        f.write("vn {:0.8f} {:0.8f} {:0.8f}\n".format(n.X, n.Y, n.Z))
    if len(mesh.TextureCoordinates) == 0 and len(mesh.Normals) == 0:
        fmt = "{0}"
    elif len(mesh.TextureCoordinates) > 0 and len(mesh.Normals) > 0:
        fmt = "{0}/{0}/{0}"
    elif len(mesh.TextureCoorinates) == 0:
        fmt = "{0}//{0}"
    else:
        fmt = "{0}/{0}"
        
    for fa in mesh.Faces:
        abc = [fmt.format(e + 1) for e in [fa.A, fa.B, fa.C]]
        f.write("f {}\n".format(" ".join(abc)))


def store_meshes(meshes, name, directory, single_file=False):
    if isinstance(meshes, Guid) or isinstance(meshes, rg.Mesh):
        fmt = "{}"
        meshes = [meshes]
        single_file = True
    else:
        fmt = "{}_{:03d}"
    if single_file:
        with open(os.path.join(directory, "{}.obj".format(name)), "w") as f:
            for i, mesh in enumerate(meshes):
                write_mesh(f, mesh, fmt.format(name, i))
    else:
        path = os.path.join(directory, name)
        if not os.path.exists(path):
            os.mkdir(path)
        for i, mesh in enumerate(meshes):
            with open(os.path.join(path, "{}_{:03d}.obj".format(name, i)), "w") as f:
                write_mesh(f, mesh, fmt.format(name, i))

def connection_to_dict(connection, centroid):
    return {
        "x_axis": list(connection.pln.XAxis),
        "y_axis": list(connection.pln.YAxis),
        "z_axis": list(connection.pln.ZAxis),
        "origin": list(connection.pln.Origin - centroid)
    }
    
def rule_to_dict(rule):
    return {
        "part1": rule.part1,
        "part2": rule.part2,
        "conn1": rule.conn1,
        "conn2": rule.conn2,
        "active": rule.active
    }
    
def parse_properties(prop):
    param_types = {
        "mass_kg": float,
        "friction": float
    }
    str_dict = {
        n.strip(): v.strip() 
        for n, v in 
        [p.split(":", 1) for p in prop.split("\n")]
        if not n.strip().startswith("#")
    }
    return {
        n: t(str_dict[n]) for n, t in param_types.items()
        if n in str_dict
    }

if run or True:
    root_path = globals()["ghdoc"].Path
    if not os.path.isabs(output_path):
        output_path = os.path.join(root_path, output_path)
    print("Using path \"{}\"".format(output_path))
    
    if not os.path.exists(output_path):
        os.makedirs(output_path)
    
    # Store meshes
    for part, mesh_group in zip(parts, decomposed_meshes.Branches):
        c = Rhino.Geometry.AreaMassProperties.Compute(part.geo).Centroid
        store_meshes(mesh_group, part.name, output_path)
        store_meshes(part.geo, part.name, output_path)
            
    # Store global target shape
    store_meshes(global_target_shape, "global_target_shape", output_path)
                     
    # Store properties
    centroids =  [
        Rhino.Geometry.AreaMassProperties.Compute(part.geo).Centroid 
        for part in parts
    ]
    
    properties = {
        "parts": [
            {
                "connections": [
                    connection_to_dict(c, centroid) for c in p.connections],
                "name": p.name,
                "mass_kg": prop["mass_kg"],
                "friction": prop["friction"]
            }
        for p, centroid, prop in zip(parts, centroids, map(parse_properties, part_properties))],
        "rules": [rule_to_dict(r) for r in rules],
        "gap_size": gap_size_mm / 1000
    }
    with open(os.path.join(output_path, "properties.json"), "w") as f:
        json.dump(properties, f, indent=True)
# ---------- end python ----------

real_time_factor = Slider(0.5, range=0.001..100)

simulation_time_step_s = Slider(0.005, range=0.001..0.5)
python_2 = GhPythonScript(parts=merge_7)  # -> parts_version; inputs parts: list
# ---------- python_2: Python ----------
__author__ = "tim"
__version__ = "2020.06.22"

import rhinoscriptsyntax as rs

if "last_version" not in globals():
    last_version = 0
else:
    last_version += 1

parts_version = last_version
# ---------- end python_2 ----------
python_3 = GhPythonScript(
    aggregation=split.ListA,
    parts_version=python_2,
    parts=merge_7,
    part_properties=merge_9,
    decomposed_meshes=smesh,
    enabled=Toggle(True),
    simulation_time_s=Slider(1, range=0..15),
    simulation_time_step_s=simulation_time_step_s,
    real_time_factor=real_time_factor,
    simulator_hostname="localhost",
    simulator_port="8000")  # -> final_part_poses; inputs aggregation: list, parts: list, part_properties: list, decomposed_meshes: tree
# ---------- python_3: Python ----------
__author__ = "tim"
__version__ = "2020.06.22"

import rhinoscriptsyntax as rs
import time

import os
import socket
import pickle
import struct
import hashlib

import Rhino.Geometry


VERSION = (1, 0, 0, 0)


class Connection:
    def __init__(self, s):
        self._socket = s
        self._buffer = ""

    def receive_object(self):
        while len(self._buffer) < 4 or len(self._buffer) < struct.unpack("<L", self._buffer[:4])[0] + 4:
            new_bytes = self._socket.recv(16)
            if len(new_bytes) == 0:
                return None
            self._buffer += new_bytes

        length = struct.unpack("<L", self._buffer[:4])[0]
        header, body = self._buffer[:4], self._buffer[4:length + 4]

        obj = pickle.loads(body)

        self._buffer = self._buffer[length + 4:]

        return obj

    def send_object(self, d):
        body = pickle.dumps(d)
        header = struct.pack("<L", len(body))
        msg = header + body
        self._socket.send(msg)


def mesh_to_dict(mesh_guid):
    mesh = rs.coercemesh(mesh_guid)
    mesh.Faces.ConvertQuadsToTriangles();
    vertices = [[float(p.X), float(p.Y), float(p.Z)] for p in mesh.Vertices]
    faces = [[int(f.A), int(f.B), int(f.C)] for f in mesh.Faces]
    return {"vertices": vertices, "faces": faces}


def send_meshes(conn):
    part_meshes = zip(parts, decomposed_meshes.Branches)
    part_meshes_dict = {
        mesh_hashes[p.name]: [mesh_to_dict(mg) for mg in mgs] for p, mgs in part_meshes
    }
    output_dict = {
        "type": "meshes", 
        "meshes": part_meshes_dict,
        "version": VERSION
    }
    conn.send_object(output_dict)


def send_sim(conn, sim_id, properties):
    part_props = [
        dict({
            "transformation": 
                [[float(p.transformation[i, j])
                for j in range(4)] for i in range(4)], 
            "hash": mesh_hashes[p.name]
        }, **properties[p.name])
        for p in aggregation
    ]
    
    output_dict = {
        "type": "sim",
        "id": sim_id,
        "sim_length_s": simulation_time_s,
        "time_step_s": simulation_time_step_s,
        "parts": part_props,
        "version": VERSION,
        "real_time_factor": real_time_factor
    }
    conn.send_object(output_dict)


def to_rhino_transform(transform):
    rt = Rhino.Geometry.Transform()
    for i in range(4):
        for j in range(4):
            rt[i, j] = transform[i][j]
    return rt


def compute_mesh_group_hash(mesh_group):
    mesh_dicts = [mesh_to_dict(m) for m in mesh_group]
    string_repr = pickle.dumps(mesh_dicts)
    return hashlib.sha256(string_repr).hexdigest()[:16]


def update_mesh_hashes():
    global mesh_hashes
    part_meshes = zip(parts, decomposed_meshes.Branches)
    mesh_hashes = {
        p.name: compute_mesh_group_hash(mg) for p, mg in part_meshes
    }
    
def parse_properties(prop):
    param_types = {
        "mass_kg": float,
        "friction": float
    }
    str_dict = {
        n.strip(): v.strip() 
        for n, v in 
        [p.split(":", 1) for p in prop.split("\n")]
        if not n.strip().startswith("#")
    }
    flat_dict = {
        n: t(str_dict[n]) for n, t in param_types.items()
        if n in str_dict
    }
    
    return {
        "mass_kg": flat_dict["mass_kg"],
        "dynamics": {
            "lateralFriction": flat_dict["friction"]
        }
    }


if enabled:
    if "previous_parts_version" not in globals():
        previous_parts_version = -1
    
    s = socket.socket(socket.AF_INET, socket.SOCK_STREAM)
    try:
        s.connect((simulator_hostname, int(simulator_port)))
        c = Connection(s)
        
        if previous_parts_version != parts_version:
            update_mesh_hashes()
            send_meshes(c)
            previous_parts_version = parts_version
            print("Updated meshes")
        
        properties = {
            part.name: parse_properties(prop)
            for part, prop in zip(parts, part_properties)
        }
        
        send_sim(c, 0, properties)
        
        result = c.receive_object()
        
        if result["type"] == "mesh_request":
            send_meshes(c)
            send_sim(c, 0, properties)
            result = c.receive_object()
        
        assert result["type"] != "error", "Received error from server: {}".format(result["desc"])
        assert result["type"] == "sim_result", "Received unexpected reply (result type \"{}\")".format(result["type"])
        assert result["id"] == 0, "Received unexpected reply (result id \"{}\")".format(result["id"])
        final_part_poses = [to_rhino_transform(t) for t in result["new_poses"]]
        
        print("Received new poses")
    finally:
        s.shutdown(socket.SHUT_RDWR)
        s.close()
# ---------- end python_3 ----------

depart_2 = Wasp_DeconstructPart(PART=simplify(graft(stochasticaggregation.PART_OUT)))  # -> NAME, ID, GEO, CONN, COLL, TR, PARENT, CHILD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; plug-in component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
cull_i = CullIndex(List=depart_2.CONN, Indices=depart_2.ACTCONN, Wrap=True)  # -> simplify(List)
merge_11 = Merge(Data1=simplify(graft(stochasticaggregation.PART_OUT)), Data2=cull_i)

depart_3 = Wasp_DeconstructPart(PART=stochasticaggregation.PART_OUT)  # -> NAME, ID, GEO, CONN, COLL, TR, PARENT, CHILD, ADD_COLL, ATTR; plug-in component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
inverse = InverseTransform(Transform=depart_3.TR)
transform = Transform(Geometry=depart_3.GEO, Transform=inverse)
transform_2 = Transform(Geometry=transform, Transform=python_3)
preview_2 = CustomPreview(Geometry=transform_2, Material=graft(ColourSwatch(SwatchColor=RGB(5, 81, 158))))

panel_14 = Panel(merge_11)
